# Grasshopper definition Example_Combining_Algorithms.ghx (Grasshopper 1.0.7)
# plug-ins: Anemone

# ---- group: Big mesh topography
# Mesh of a topography https://www.uahirise.org/dtm/
mesh = Mesh(<mesh referenced from the Rhino model>)
faceb = FaceBoundaries(Mesh=mesh)
smesh = SimpleMesh(Brep=faceb)  # disabled

# ---- group: Split and rebuild mesh
mesh_2 = Mesh(<mesh referenced from the Rhino model>)
facen = FaceNormals(Mesh=mesh_2)  # -> Centers, Normals
brep = Brep(<brep referenced from the Rhino model>)
brepinc = PointInBrep(Brep=brep, Point=facen.Centers, Strict=False)
cull = CullPattern(List=smesh, CullPattern=brepinc)
mjoin = MeshJoin(Meshes=cull)
weld = WeldMesh(Mesh=mjoin, Angle=3.141592654)
demesh = DeconstructMesh(Mesh=weld)  # -> Vertices, Faces, Colours, Normals

mesh_3 = Mesh(<mesh referenced from the Rhino model>)
facen_2 = FaceNormals(Mesh=mesh_3)  # -> Centers, Normals
brep_2 = Brep(<brep referenced from the Rhino model>)
brepinc_2 = PointInBrep(Brep=brep_2, Point=facen_2.Centers, Strict=False)
cull_2 = CullPattern(List=smesh, CullPattern=brepinc_2)
mjoin_2 = MeshJoin(Meshes=cull_2)
weld_2 = WeldMesh(Mesh=mjoin_2, Angle=3.141592654)
demesh_2 = DeconstructMesh(Mesh=weld_2)  # -> Vertices, Faces, Colours, Normals

# ---- group: Points you want to exclude from terrain 1
# connect to' excluded_pts' input of
# Astar/Dijkstra components
brep_3 = Brep(<brep referenced from the Rhino model>)
brepinc_3 = PointInBrep(Brep=brep_3, Point=demesh.Vertices, Strict=False)
cull_3 = CullPattern(List=demesh.Vertices, CullPattern=brepinc_3)

# ---- group: Points you want to exclude from terrain 2
# connect to' excluded_pts' input of
# Astar/Dijkstra components
brep_4 = Brep(<brep referenced from the Rhino model>)
brepinc_4 = PointInBrep(Brep=brep_4, Point=demesh_2.Vertices, Strict=False)
cull_4 = CullPattern(List=demesh_2.Vertices, CullPattern=brepinc_4)

# ---- group: end_points of mesh edges
medges = MeshEdges(Mesh=weld_2)  # -> NakedEdges, InteriorEdges, NonManifoldEdges
crv = Curve(medges.InteriorEdges)
crv_2 = Curve(medges.NakedEdges)
merge = Merge(Data1=flatten(crv_2), Data2=flatten(crv))  # -> flatten(Result)
end = EndPoints(Curve=merge)  # -> Start, End

# ---- group: Start_pt and Goal_pt
pt = Point(<point referenced from the Rhino model>)
pt_2 = Point(<point referenced from the Rhino model>)
cp = ClosestPoint(Point=pt_2, Cloud=demesh_2.Vertices)  # -> ClosestPoint, CPIndex, Distance
cp_2 = ClosestPoint(Point=pt, Cloud=demesh_2.Vertices)  # -> ClosestPoint, CPIndex, Distance

pt_3 = Point(<point referenced from the Rhino model>)
pt_4 = Point(<point referenced from the Rhino model>)
cp_3 = ClosestPoint(Point=pt_3, Cloud=demesh.Vertices)  # -> ClosestPoint, CPIndex, Distance
cp_4 = ClosestPoint(Point=pt_4, Cloud=demesh.Vertices)  # -> ClosestPoint, CPIndex, Distance

# ---- group: Dijkstra’s Algorithm that can adapt to all meshes
pi = Pi(Factor=1)
division = Division(A=pi, B=Slider(10, range=1..10))
deg = Degrees(Radians=division)
python = GhPythonScript(
    mesh_pts=demesh_2.Vertices,
    srt_pts=end.Start,
    end_pts=end.End,
    PointA=cp.ClosestPoint,
    PointB=cp_2.ClosestPoint,
    Network=Slider(1, range=0..1),
    max_Angle=division)  # -> out, sorted_pts, optimal_sequence, closed; inputs mesh_pts: list of Point3d, srt_pts: list of Point3d, end_pts: list of Point3d, PointA: Point3d, PointB: Point3d, Network: Int32, excluded_pts: list of Point3d; disabled
# ---------- python: Python ----------
import Rhino.Geometry as rg
import math
from ghpythonlib.treehelpers import list_to_tree



#We sort the points of the topography in the X and the Y axis
def sort_pts(mesh_pts):
    pt_sort = []
    for i, pt in enumerate(mesh_pts):
        pt_sort.append(pt.X*10000 + pt.Y*10)
    sortedp = sorted(zip(mesh_pts, pt_sort))
    sorted_pts = []
    #unpack tuples and retrieve only the points
    for pt, val in sortedp:
        sorted_pts.append(pt)
        
    return sorted_pts


#We split the plain list into list of lists to make neighbor search easier
def pts_branched(sorted_pts):
    Grid = []
    new_list = []
    for i, pt in enumerate(sorted_pts):
        if (i != 0 and pt.X != sorted_pts[i-1].X):
            Grid.append(new_list)
            new_list = []
        elif i == len(sorted_pts)-1:
            new_list.append([i, pt.Z])
            Grid.append(new_list)
            break
        new_list.append([i,pt.Z])
#    print len(Grid[2])
    return Grid


#find index of pointA (Start point) and pointB (Goal point) in the new ordered list
def Start_End_Points(sorted_pts):
    Start_point = []
    Goal_point = []
    for i, pt in enumerate(sorted_pts):
        if pt == PointA:
            Start_point.append(i)
        if pt == PointB:
            Goal_point.append(i)
    return Start_point[0], Goal_point[0]


#The Tree will be the playground of the Astar
#Tree is a dict that has every node as a key, and its lists of [neighbor + cost] as a value
#in the for loop a node = [pt_index, pt.Z]

def Playground(Grid):
    global max_Angle
    Tree = {}
    for i, list in enumerate(Grid):
        for j, node in enumerate(list):
            if i > 0 and abs(abs(node[1]) - abs(Grid[i-1][j][1])) / math.sqrt(12**2 + (abs(node[1]) - abs(Grid[i-1][j][1]))**2) < math.sin(max_Angle):
                Tree.setdefault(node[0], []).append([Grid[i-1][j][0], math.sqrt(math.pow(abs(abs(Grid[i-1][j][1])-abs(Grid[i][j][1])),2) + math.pow(12,2))])
            if j > 0 and abs(abs(node[1]) - abs(Grid[i][j-1][1])) / math.sqrt(12**2 + (abs(node[1]) - abs(Grid[i][j-1][1]))**2) < math.sin(max_Angle):
                Tree.setdefault(node[0], []).append([Grid[i][j-1][0], math.sqrt(math.pow(abs(abs(Grid[i][j-1][1])-abs(Grid[i][j][1])),2) + math.pow(12,2))])
            if i < len(Grid) - 1 and abs(abs(node[1]) - abs(Grid[i+1][j][1])) / math.sqrt(12**2 + (abs(node[1]) - abs(Grid[i+1][j][1]))**2) < math.sin(max_Angle):
                Tree.setdefault(node[0], []).append([Grid[i+1][j][0], math.sqrt(math.pow(abs(abs(Grid[i+1][j][1])-abs(Grid[i][j][1])),2) + math.pow(12,2))])
            if j < len(list) - 1 and abs(abs(node[1]) - abs(Grid[i][j+1][1])) / math.sqrt(12**2 + (abs(node[1]) - abs(Grid[i][j+1][1]))**2) < math.sin(max_Angle):
                Tree.setdefault(node[0], []).append([Grid[i][j+1][0], math.sqrt(math.pow(abs(abs(Grid[i][j+1][1])-abs(Grid[i][j][1])),2) + math.pow(12,2))])
    return Tree


#A second version that allows you to add breps to exclude points

def Playground_with_pt_exclusion(Grid):
    global max_Angle, excluded_pts
    Tree = {}
    for i, list in enumerate(Grid):
        for j, node in enumerate(list):
            if i > 0 and abs(abs(node[1]) - abs(Grid[i-1][j][1])) / math.sqrt(12**2 + (abs(node[1]) - abs(Grid[i-1][j][1]))**2) < math.sin(max_Angle) and sorted_pts[node[0]] not in excluded_pts and sorted_pts[Grid[i-1][j][0]] not in excluded_pts:
                Tree.setdefault(node[0], []).append([Grid[i-1][j][0], math.sqrt(math.pow(abs(abs(Grid[i-1][j][1])-abs(Grid[i][j][1])),2) + math.pow(12,2))])
            if j > 0 and abs(abs(node[1]) - abs(Grid[i][j-1][1])) / math.sqrt(12**2 + (abs(node[1]) - abs(Grid[i][j-1][1]))**2) < math.sin(max_Angle) and sorted_pts[node[0]] not in excluded_pts and sorted_pts[Grid[i][j-1][0]] not in excluded_pts:
                Tree.setdefault(node[0], []).append([Grid[i][j-1][0], math.sqrt(math.pow(abs(abs(Grid[i][j-1][1])-abs(Grid[i][j][1])),2) + math.pow(12,2))])
            if i < len(Grid) - 1 and abs(abs(node[1]) - abs(Grid[i+1][j][1])) / math.sqrt(12**2 + (abs(node[1]) - abs(Grid[i+1][j][1]))**2) < math.sin(max_Angle) and sorted_pts[node[0]] not in excluded_pts and sorted_pts[Grid[i+1][j][0]] not in excluded_pts:
                Tree.setdefault(node[0], []).append([Grid[i+1][j][0], math.sqrt(math.pow(abs(abs(Grid[i+1][j][1])-abs(Grid[i][j][1])),2) + math.pow(12,2))])
            if j < len(list) - 1 and abs(abs(node[1]) - abs(Grid[i][j+1][1])) / math.sqrt(12**2 + (abs(node[1]) - abs(Grid[i][j+1][1]))**2) < math.sin(max_Angle) and sorted_pts[node[0]] not in excluded_pts and sorted_pts[Grid[i][j+1][0]] not in excluded_pts:
                Tree.setdefault(node[0], []).append([Grid[i][j+1][0], math.sqrt(math.pow(abs(abs(Grid[i][j+1][1])-abs(Grid[i][j][1])),2) + math.pow(12,2))])
    return Tree


#A more reliable way to generate the Tree if the def Playground is not working properly, it may be slower

def Playground_alternative(srt_pts, end_pts, sorted_pts):
    Tree = {}
    closed = []
    for srt_pt,end_pt in zip(srt_pts, end_pts):
        if ((abs(srt_pt.Z) - abs(end_pt.Z)) / math.sqrt((12**2) + (abs(srt_pt.Z) - abs(end_pt.Z))**2)) < math.sin(max_Angle):
            Tree.setdefault(sorted_pts.index(end_pt),[]).append([sorted_pts.index(srt_pt), math.sqrt((abs(srt_pt.X) - abs(end_pt.X))**2 + (abs(srt_pt.Y) - abs(end_pt.Y))**2 + (abs(srt_pt.Z) - abs(end_pt.Z))**2)])
            Tree.setdefault(sorted_pts.index(srt_pt),[]).append([sorted_pts.index(end_pt), math.sqrt((abs(srt_pt.X) - abs(end_pt.X))**2 + (abs(srt_pt.Y) - abs(end_pt.Y))**2 + (abs(srt_pt.Z) - abs(end_pt.Z))**2)])
    return Tree


#Defining Dijkstra’s logic :  searching for neighbor nodes iteratively until finding goal node. Then using weight to loop over the sequence of points from goal to start to find the shortest path.



def DijkstraAlgorithm():
    global Tree, Start_point, Goal_point
    cost = {Start_point: 0}
    closed = []
    came_from = {}
    opened = [[Start_point, cost[Start_point]]]
    #Dijkstra’s Search logic
    while True:
        #pick a node
        node = opened[0][0]
        closed.append(opened[0])
        del opened[0]
        #End the loop if we reach the goal node
        if closed[-1][0] == Goal_point:
            print "Goal point found !"
            break
        for item in Tree[node]:
            if item[0] in [closed_item[0] for closed_item in closed]:
                continue
            cost_node = cost[node] + item[1]
            temp = [item[0], cost_node]
            if temp[0] in [open[0] for open in opened]:
                if cost[node] + item[1] < cost[temp[0]]:
                    cost.update({item[0]: cost[node] + item[1]})
                    chosen_index = [open[0] for open in opened].index(temp[0])
                    del opened[chosen_index]
                    opened.append(temp)
                    came_from[temp[0]] = node
            elif temp[0] not in [open[0] for open in opened]:
                cost.update({item[0]: cost[node] + item[1]})
                opened.append(temp)
                came_from[temp[0]] = node
        #Stopping the loop before having an error
        if len(opened) == 0:
            print "Failed to find the Goal point..."
            break
    #Loop back to find the sequence 
    trace_node = Goal_point
    optimal_sequence = [Goal_point]
    while trace_node in came_from.Keys:
        trace_node = came_from[trace_node]
        optimal_sequence.append(trace_node)
    
    
    optimal_sequence.reverse()
    
    return  closed, optimal_sequence



#Running the Code
if Network == 0:
    if len(excluded_pts) == 0:
        try:
            sorted_pts = sort_pts(mesh_pts)
            Grid = pts_branched(sorted_pts)
            Start_point, Goal_point = Start_End_Points(sorted_pts)
            Tree = Playground(Grid)
            closed, optimal_sequence = DijkstraAlgorithm()
            closed = list_to_tree(closed)
        except Exception:
            print("Sorry, missing or wrong Data")
            
    elif len(excluded_pts) != 0:
        try:
            sorted_pts = sort_pts(mesh_pts)
            Grid = pts_branched(sorted_pts)
            Start_point, Goal_point = Start_End_Points(sorted_pts)
            Tree = Playground_with_pt_exclusion(Grid)
            closed, optimal_sequence = DijkstraAlgorithm()
            closed = list_to_tree(closed)
        except Exception:
            print("Sorry, missing or wrong Data")

if Network == 1:
    try:
        sorted_pts = sort_pts(mesh_pts)
        Grid = pts_branched(sorted_pts)
        Start_point, Goal_point = Start_End_Points(sorted_pts)
        Tree = Playground_alternative(srt_pts, end_pts, sorted_pts)
        Heuristic = heuristic(sorted_pts)
        closed, optimal_sequence = DijkstraAlgorithm()
        closed = list_to_tree(closed)
    except Exception:
        print("Sorry, missing or wrong Data")
# ---------- end python ----------
max_angle_in_degrees = Panel(deg)
panel = Panel(python.out)
item = ListItem(List=python.sorted_pts, Index=python.optimal_sequence, Wrap=True)
pline = PolyLine(Vertices=item, Closed=False)
len = Length(Curve=pline)
# Heavy versions of Astar and Dijkstra that
# work with only kind of  meshes
# (becomes very slow with heavy mesh : around 30sec to run every time)
panel_2 = Panel(len)

# ---- group: A star Algorithm that can adapt to all meshes
pi_2 = Pi(Factor=1)
division_2 = Division(A=pi_2, B=Slider(4, range=1..10))
deg_2 = Degrees(Radians=division_2)
python_2 = GhPythonScript(
    mesh_pts=demesh_2.Vertices,
    srt_pts=end.Start,
    end_pts=end.End,
    PointA=cp.ClosestPoint,
    PointB=cp_2.ClosestPoint,
    Network=Slider(1, range=0..1),
    max_Angle=division_2,
    excluded_pts=cull_4)  # -> out, sorted_pts, optimal_sequence, closed; inputs mesh_pts: list of Point3d, srt_pts: list of Point3d, end_pts: list of Point3d, PointA: Point3d, PointB: Point3d, Network: Int32, excluded_pts: list of Point3d; disabled
# ---------- python_2: Python ----------
import Rhino.Geometry as rg
import math
from ghpythonlib.treehelpers import list_to_tree



#We sort the points of the topography in the X and the Y axis
def sort_pts(mesh_pts):
    pt_sort = []
    for i, pt in enumerate(mesh_pts):
        pt_sort.append(pt.X*10000 + pt.Y*10)
    sortedp = sorted(zip(mesh_pts, pt_sort))
    sorted_pts = []
    #unpack tuples and retrieve only the points
    for pt, val in sortedp:
        sorted_pts.append(pt)
        
    return sorted_pts


#We split the plain list into list of lists to make neighbor search easier
def pts_branched(sorted_pts):
    Grid = []
    new_list = []
    for i, pt in enumerate(sorted_pts):
        if (i != 0 and pt.X != sorted_pts[i-1].X):
            Grid.append(new_list)
            new_list = []
        elif i == len(sorted_pts)-1:
            new_list.append([i, pt.Z])
            Grid.append(new_list)
            break
        new_list.append([i,pt.Z])
#    print len(Grid[2])
    return Grid


#find index of pointA (Start point) and pointB (Goal point) in the new ordered list
def Start_End_Points(sorted_pts):
    global PointA, PointB
    Start_point = []
    Goal_point = []
    for i, pt in enumerate(sorted_pts):
        if pt == PointA:
            Start_point.append(i)
        if pt == PointB:
            Goal_point.append(i)
    return Start_point[0], Goal_point[0]


#The Tree will be the playground of the Astar
#Tree is a dict that has every node as a key, and its lists of [neighbor + cost] as a value
#in the for loop a node = [pt_index, pt.Z]
#Playground is more suited for orthogonal networks (XY grid)

def Playground(Grid):
    global max_Angle
    Tree = {}
    for i, list in enumerate(Grid):
        for j, node in enumerate(list):
            if i > 0 and abs(abs(node[1]) - abs(Grid[i-1][j][1])) / math.sqrt(12**2 + (abs(node[1]) - abs(Grid[i-1][j][1]))**2) < math.sin(max_Angle):
                Tree.setdefault(node[0], []).append([Grid[i-1][j][0], math.sqrt(math.pow(abs(abs(Grid[i-1][j][1])-abs(Grid[i][j][1])),2) + math.pow(12,2))])
            if j > 0 and abs(abs(node[1]) - abs(Grid[i][j-1][1])) / math.sqrt(12**2 + (abs(node[1]) - abs(Grid[i][j-1][1]))**2) < math.sin(max_Angle):
                Tree.setdefault(node[0], []).append([Grid[i][j-1][0], math.sqrt(math.pow(abs(abs(Grid[i][j-1][1])-abs(Grid[i][j][1])),2) + math.pow(12,2))])
            if i < len(Grid) - 1 and abs(abs(node[1]) - abs(Grid[i+1][j][1])) / math.sqrt(12**2 + (abs(node[1]) - abs(Grid[i+1][j][1]))**2) < math.sin(max_Angle):
                Tree.setdefault(node[0], []).append([Grid[i+1][j][0], math.sqrt(math.pow(abs(abs(Grid[i+1][j][1])-abs(Grid[i][j][1])),2) + math.pow(12,2))])
            if j < len(list) - 1 and abs(abs(node[1]) - abs(Grid[i][j+1][1])) / math.sqrt(12**2 + (abs(node[1]) - abs(Grid[i][j+1][1]))**2) < math.sin(max_Angle):
                Tree.setdefault(node[0], []).append([Grid[i][j+1][0], math.sqrt(math.pow(abs(abs(Grid[i][j+1][1])-abs(Grid[i][j][1])),2) + math.pow(12,2))])
    return Tree


#A second version that allows you to add breps to exclude points

def Playground_with_pt_exclusion(Grid):
    global max_Angle, excluded_pts
    Tree = {}
    for i, list in enumerate(Grid):
        for j, node in enumerate(list):
            if i > 0 and abs(abs(node[1]) - abs(Grid[i-1][j][1])) / math.sqrt(12**2 + (abs(node[1]) - abs(Grid[i-1][j][1]))**2) < math.sin(max_Angle) and sorted_pts[node[0]] not in excluded_pts and sorted_pts[Grid[i-1][j][0]] not in excluded_pts:
                Tree.setdefault(node[0], []).append([Grid[i-1][j][0], math.sqrt(math.pow(abs(abs(Grid[i-1][j][1])-abs(Grid[i][j][1])),2) + math.pow(12,2))])
            if j > 0 and abs(abs(node[1]) - abs(Grid[i][j-1][1])) / math.sqrt(12**2 + (abs(node[1]) - abs(Grid[i][j-1][1]))**2) < math.sin(max_Angle) and sorted_pts[node[0]] not in excluded_pts and sorted_pts[Grid[i][j-1][0]] not in excluded_pts:
                Tree.setdefault(node[0], []).append([Grid[i][j-1][0], math.sqrt(math.pow(abs(abs(Grid[i][j-1][1])-abs(Grid[i][j][1])),2) + math.pow(12,2))])
            if i < len(Grid) - 1 and abs(abs(node[1]) - abs(Grid[i+1][j][1])) / math.sqrt(12**2 + (abs(node[1]) - abs(Grid[i+1][j][1]))**2) < math.sin(max_Angle) and sorted_pts[node[0]] not in excluded_pts and sorted_pts[Grid[i+1][j][0]] not in excluded_pts:
                Tree.setdefault(node[0], []).append([Grid[i+1][j][0], math.sqrt(math.pow(abs(abs(Grid[i+1][j][1])-abs(Grid[i][j][1])),2) + math.pow(12,2))])
            if j < len(list) - 1 and abs(abs(node[1]) - abs(Grid[i][j+1][1])) / math.sqrt(12**2 + (abs(node[1]) - abs(Grid[i][j+1][1]))**2) < math.sin(max_Angle) and sorted_pts[node[0]] not in excluded_pts and sorted_pts[Grid[i][j+1][0]] not in excluded_pts:
                Tree.setdefault(node[0], []).append([Grid[i][j+1][0], math.sqrt(math.pow(abs(abs(Grid[i][j+1][1])-abs(Grid[i][j][1])),2) + math.pow(12,2))])
    return Tree


#A more reliable way to generate the Tree if the def Playground is not working properly, it may be slower

def Playground_alternative(srt_pts, end_pts, sorted_pts):
    Tree = {}
    closed = []
    for srt_pt,end_pt in zip(srt_pts, end_pts):
        if ((abs(srt_pt.Z) - abs(end_pt.Z)) / math.sqrt((12**2) + (abs(srt_pt.Z) - abs(end_pt.Z))**2)) < math.sin(max_Angle) and srt_pt not in excluded_pts and end_pt not in excluded_pts:
            Tree.setdefault(sorted_pts.index(end_pt),[]).append([sorted_pts.index(srt_pt), math.sqrt((abs(srt_pt.X) - abs(end_pt.X))**2 + (abs(srt_pt.Y) - abs(end_pt.Y))**2 + (abs(srt_pt.Z) - abs(end_pt.Z))**2)])
            Tree.setdefault(sorted_pts.index(srt_pt),[]).append([sorted_pts.index(end_pt), math.sqrt((abs(srt_pt.X) - abs(end_pt.X))**2 + (abs(srt_pt.Y) - abs(end_pt.Y))**2 + (abs(srt_pt.Z) - abs(end_pt.Z))**2)])
    return Tree


#Heuristic is a dict that contains everypoint and its heuristic value which is the distance to the goal point (PointB).

def heuristic(sorted_pts):
    Heuristic = {}
    for i, pt in enumerate(sorted_pts):
        Heuristic[i] = pt.DistanceTo(PointB)
    return Heuristic


#Defining Astar logic, searching nodes with the best cumulated cost (heuristic + gcost) until finding goal node. Then using weight to loop over the sequence of points from goal to start.

def AstarAlgorithm():
    global Tree, Heuristic, Start_point, Goal_point
    cost = {Start_point: 0}
    closed = []
    came_from = {}
    opened = [[Start_point, Heuristic[Start_point]]]
    #A Star Search logic
    while True:
        fn = [i[1] for i in opened]
        chosen_index = fn.index(min(fn))
        node = opened[chosen_index][0]
        closed.append(opened[chosen_index])
        del opened[chosen_index]
        #End the loop if we reach the goal node
        if closed[-1][0] == Goal_point:
            print "Goal point found !"
            break
        for item in Tree[node]:
            if item[0] in [closed_item[0] for closed_item in closed]:
                continue
            fn_node = cost[node] + (Heuristic[item[0]]) + item[1]
            temp = [item[0], fn_node]
            if temp[0] in [open[0] for open in opened]:
                if cost[node] + item[1] < cost[temp[0]]:
                    cost.update({item[0]: cost[node] + item[1]})
                    chosen_index = [open[0] for open in opened].index(temp[0])
                    del opened[chosen_index]
                    opened.append(temp)
                    came_from[temp[0]] = node
            elif temp[0] not in [open[0] for open in opened]:
                cost.update({item[0]: cost[node] + item[1]})
                opened.append(temp)
                came_from[temp[0]] = node
        #Stopping the loop before having an error
        if len(opened) == 0:
            print "Failed to find the Goal point..."
            break
    #Loop back to find the sequence 
    trace_node = Goal_point
    optimal_sequence = [Goal_point]
    while trace_node in came_from.Keys:
        trace_node = came_from[trace_node]
        optimal_sequence.append(trace_node)
    
    
    optimal_sequence.reverse()
    
    return  closed, optimal_sequence



#Running the Code
if Network == 0:
    if len(excluded_pts) == 0:
        try:
            sorted_pts = sort_pts(mesh_pts)
            Grid = pts_branched(sorted_pts)
            Start_point, Goal_point = Start_End_Points(sorted_pts)
            Tree = Playground(Grid)
            Heuristic = heuristic(sorted_pts)
            closed, optimal_sequence = AstarAlgorithm()
            closed = list_to_tree(closed)
        except Exception:
            print("Sorry, missing or wrong Data")
            
    elif len(excluded_pts) != 0:
        try:
            sorted_pts = sort_pts(mesh_pts)
            Grid = pts_branched(sorted_pts)
            Start_point, Goal_point = Start_End_Points(sorted_pts)
            Tree = Playground_with_pt_exclusion(Grid)
            Heuristic = heuristic(sorted_pts)
            closed, optimal_sequence = AstarAlgorithm()
            closed = list_to_tree(closed)
        except Exception:
            print("Sorry, missing or wrong Data")

if Network == 1:
    try:
        sorted_pts = sort_pts(mesh_pts)
        Grid = pts_branched(sorted_pts)
        Start_point, Goal_point = Start_End_Points(sorted_pts)
        Tree = Playground_alternative(srt_pts, end_pts, sorted_pts)
        Heuristic = heuristic(sorted_pts)
        closed, optimal_sequence = AstarAlgorithm()
        closed = list_to_tree(closed)
    except Exception:
        print("Sorry, missing or wrong Data")
# ---------- end python_2 ----------
max_angle_in_degrees_2 = Panel(deg_2)
item_2 = ListItem(List=python_2.sorted_pts, Index=python_2.optimal_sequence, Wrap=True)
panel_3 = Panel(python_2.out)
pline_2 = PolyLine(Vertices=item_2, Closed=False)
len_2 = Length(Curve=pline_2)
panel_4 = Panel(len_2)

# ---- group: A star Algorithm made for rectangular orthogonal meshes
pi_3 = Pi(Factor=1)
division_3 = Division(A=pi_3, B=Slider(10, range=1..10))
python_3 = GhPythonScript(mesh_pts=demesh.Vertices, PointA=cp_3.ClosestPoint, PointB=cp_4.ClosestPoint, max_Angle=division_3)  # -> out, sorted_pts, optimal_sequence, closed; inputs mesh_pts: list of Point3d, PointA: Point3d, PointB: Point3d, excluded_pts: list of Point3d; disabled
# ---------- python_3: Python ----------
import Rhino.Geometry as rg
import math
from ghpythonlib.treehelpers import list_to_tree



#We sort the points of the topography in the X and the Y axis
def sort_pts(mesh_pts):
    pt_sort = []
    for i, pt in enumerate(mesh_pts):
        pt_sort.append(pt.X*10000 + pt.Y*10)
    sortedp = sorted(zip(mesh_pts, pt_sort))
    sorted_pts = []
    #unpack tuples and retrieve only the points
    for pt, val in sortedp:
        sorted_pts.append(pt)
        
    return sorted_pts


#We split the plain list into list of lists to make neighbor search easier
def pts_branched(sorted_pts):
    Grid = []
    new_list = []
    for i, pt in enumerate(sorted_pts):
        if (i != 0 and pt.X != sorted_pts[i-1].X):
            Grid.append(new_list)
            new_list = []
        elif i == len(sorted_pts)-1:
            new_list.append([i, pt.Z])
            Grid.append(new_list)
            break
        new_list.append([i,pt.Z])
    return Grid


#find index of pointA (Start point) and pointB (Goal point) in the new ordered list
def Start_End_Points(sorted_pts):
    Start_point = []
    Goal_point = []
    for i, pt in enumerate(sorted_pts):
        if pt == PointA:
            Start_point.append(i)
        if pt == PointB:
            Goal_point.append(i)
    return Start_point[0], Goal_point[0]


#The Tree will be the playground of the Astar
#Tree is a dict that has every node as a key, and its lists of [neighbor + cost] as a value
#in the for loop a node = [pt_index, pt.Z]

def Playground(Grid):
    global max_Angle
    Tree = {}
    for i, list in enumerate(Grid):
        for j, node in enumerate(list):
            if i > 0 and abs(abs(node[1]) - abs(Grid[i-1][j][1])) / math.sqrt(12**2 + (abs(node[1]) - abs(Grid[i-1][j][1]))**2) < math.sin(max_Angle):
                Tree.setdefault(node[0], []).append([Grid[i-1][j][0], math.sqrt(math.pow(abs(abs(Grid[i-1][j][1])-abs(Grid[i][j][1])),2) + math.pow(12,2))])
            if j > 0 and abs(abs(node[1]) - abs(Grid[i][j-1][1])) / math.sqrt(12**2 + (abs(node[1]) - abs(Grid[i][j-1][1]))**2) < math.sin(max_Angle):
                Tree.setdefault(node[0], []).append([Grid[i][j-1][0], math.sqrt(math.pow(abs(abs(Grid[i][j-1][1])-abs(Grid[i][j][1])),2) + math.pow(12,2))])
            if i < len(Grid) - 1 and abs(abs(node[1]) - abs(Grid[i+1][j][1])) / math.sqrt(12**2 + (abs(node[1]) - abs(Grid[i+1][j][1]))**2) < math.sin(max_Angle):
                Tree.setdefault(node[0], []).append([Grid[i+1][j][0], math.sqrt(math.pow(abs(abs(Grid[i+1][j][1])-abs(Grid[i][j][1])),2) + math.pow(12,2))])
            if j < len(list) - 1 and abs(abs(node[1]) - abs(Grid[i][j+1][1])) / math.sqrt(12**2 + (abs(node[1]) - abs(Grid[i][j+1][1]))**2) < math.sin(max_Angle):
                Tree.setdefault(node[0], []).append([Grid[i][j+1][0], math.sqrt(math.pow(abs(abs(Grid[i][j+1][1])-abs(Grid[i][j][1])),2) + math.pow(12,2))])
    return Tree


#A second version that allows you to add breps to exclude points

def Playground_with_pt_exclusion(Grid):
    global max_Angle, excluded_pts
    Tree = {}
    for i, list in enumerate(Grid):
        for j, node in enumerate(list):
            if i > 0 and abs(abs(node[1]) - abs(Grid[i-1][j][1])) / math.sqrt(12**2 + (abs(node[1]) - abs(Grid[i-1][j][1]))**2) < math.sin(max_Angle) and sorted_pts[node[0]] not in excluded_pts and sorted_pts[Grid[i-1][j][0]] not in excluded_pts:
                Tree.setdefault(node[0], []).append([Grid[i-1][j][0], math.sqrt(math.pow(abs(abs(Grid[i-1][j][1])-abs(Grid[i][j][1])),2) + math.pow(12,2))])
            if j > 0 and abs(abs(node[1]) - abs(Grid[i][j-1][1])) / math.sqrt(12**2 + (abs(node[1]) - abs(Grid[i][j-1][1]))**2) < math.sin(max_Angle) and sorted_pts[node[0]] not in excluded_pts and sorted_pts[Grid[i][j-1][0]] not in excluded_pts:
                Tree.setdefault(node[0], []).append([Grid[i][j-1][0], math.sqrt(math.pow(abs(abs(Grid[i][j-1][1])-abs(Grid[i][j][1])),2) + math.pow(12,2))])
            if i < len(Grid) - 1 and abs(abs(node[1]) - abs(Grid[i+1][j][1])) / math.sqrt(12**2 + (abs(node[1]) - abs(Grid[i+1][j][1]))**2) < math.sin(max_Angle) and sorted_pts[node[0]] not in excluded_pts and sorted_pts[Grid[i+1][j][0]] not in excluded_pts:
                Tree.setdefault(node[0], []).append([Grid[i+1][j][0], math.sqrt(math.pow(abs(abs(Grid[i+1][j][1])-abs(Grid[i][j][1])),2) + math.pow(12,2))])
            if j < len(list) - 1 and abs(abs(node[1]) - abs(Grid[i][j+1][1])) / math.sqrt(12**2 + (abs(node[1]) - abs(Grid[i][j+1][1]))**2) < math.sin(max_Angle) and sorted_pts[node[0]] not in excluded_pts and sorted_pts[Grid[i][j+1][0]] not in excluded_pts:
                Tree.setdefault(node[0], []).append([Grid[i][j+1][0], math.sqrt(math.pow(abs(abs(Grid[i][j+1][1])-abs(Grid[i][j][1])),2) + math.pow(12,2))])
    return Tree


#Heuristic is a dict that contains everypoint and its heuristic value which is the distance to the goal point (PointB).

def heuristic(sorted_pts):
    Heuristic = {}
    for i, pt in enumerate(sorted_pts):
        Heuristic[i] = pt.DistanceTo(PointB)
    return Heuristic

#Defining Astar logic, searching nodes with the best cumulated cost (heuristic + gcost) until finding goal node. Then using weight to loop over the sequence of points from goal to start.



def AstarAlgorithm():
    global Tree, Heuristic, Start_point, Goal_point
    cost = {Start_point: 0}
    closed = []
    came_from = {}
    opened = [[Start_point, Heuristic[Start_point]]]
    #A Star Search logic
    while True:
        fn = [i[1] for i in opened]
        chosen_index = fn.index(min(fn))
        node = opened[chosen_index][0]
        closed.append(opened[chosen_index])
        del opened[chosen_index]
        #End the loop if we reach the goal node
        if closed[-1][0] == Goal_point:
            print "Goal point found !"
            break
        for item in Tree[node]:
            if item[0] in [closed_item[0] for closed_item in closed]:
                continue
            fn_node = cost[node] + (Heuristic[item[0]]) + item[1]
            temp = [item[0], fn_node]
            if temp[0] in [open[0] for open in opened]:
                if cost[node] + item[1] < cost[temp[0]]:
                    cost.update({item[0]: cost[node] + item[1]})
                    chosen_index = [open[0] for open in opened].index(temp[0])
                    del opened[chosen_index]
                    opened.append(temp)
                    came_from[temp[0]] = node
            elif temp[0] not in [open[0] for open in opened]:
                cost.update({item[0]: cost[node] + item[1]})
                opened.append(temp)
                came_from[temp[0]] = node
        #Stopping the loop before having an error
        if len(opened) == 0:
            print "Failed to find the Goal point..."
            break
    #Loop back to find the sequence 
    trace_node = Goal_point
    optimal_sequence = [Goal_point]
    while trace_node in came_from.Keys:
        trace_node = came_from[trace_node]
        optimal_sequence.append(trace_node)
    
    
    optimal_sequence.reverse()
    
    return  closed, optimal_sequence



#Running the Code
if len(excluded_pts) == 0:
    try:
        sorted_pts = sort_pts(mesh_pts)
        Grid = pts_branched(sorted_pts)
        Start_point, Goal_point = Start_End_Points(sorted_pts)
        Tree = Playground(Grid)
        Heuristic = heuristic(sorted_pts)
        closed, optimal_sequence = AstarAlgorithm()
        closed = list_to_tree(closed)
    except Exception:
        print("Sorry, missing or wrong Data")
        
elif len(excluded_pts) != 0:
    try:
        sorted_pts = sort_pts(mesh_pts)
        Grid = pts_branched(sorted_pts)
        Start_point, Goal_point = Start_End_Points(sorted_pts)
        Tree = Playground_with_pt_exclusion(Grid)
        Heuristic = heuristic(sorted_pts)
        closed, optimal_sequence = AstarAlgorithm()
        closed = list_to_tree(closed)
    except Exception:
        print("Sorry, missing or wrong Data")
# ---------- end python_3 ----------
panel_5 = Panel(python_3.out)
item_3 = ListItem(List=python_3.sorted_pts, Index=python_3.optimal_sequence, Wrap=True)
pline_3 = PolyLine(Vertices=item_3, Closed=False)
len_3 = Length(Curve=pline_3)
panel_6 = Panel(len_3)

# ---- group: Dijkstra’s Algorithm made for rectangular orthogonal meshes
pi_4 = Pi(Factor=1)
division_4 = Division(A=pi_4, B=Slider(10, range=1..10))
deg_3 = Degrees(Radians=division_4)
python_4 = GhPythonScript(mesh_pts=demesh.Vertices, PointA=cp_3.ClosestPoint, PointB=cp_4.ClosestPoint, max_Angle=division_4)  # -> out, sorted_pts, optimal_sequence, closed; inputs mesh_pts: list of Point3d, PointA: Point3d, PointB: Point3d, excluded_pts: list of Point3d; disabled
# ---------- python_4: Python ----------
import Rhino.Geometry as rg
import math
from ghpythonlib.treehelpers import list_to_tree



#We sort the points of the topography in the X and the Y axis
def sort_pts(mesh_pts):
    pt_sort = []
    for i, pt in enumerate(mesh_pts):
        pt_sort.append(pt.X*10000 + pt.Y*10)
    sortedp = sorted(zip(mesh_pts, pt_sort))
    sorted_pts = []
    #unpack tuples and retrieve only the points
    for pt, val in sortedp:
        sorted_pts.append(pt)
        
    return sorted_pts


#We split the plain list into list of lists to make neighbor search easier
def pts_branched(sorted_pts):
    Grid = []
    new_list = []
    for i, pt in enumerate(sorted_pts):
        if (i != 0 and pt.X != sorted_pts[i-1].X):
            Grid.append(new_list)
            new_list = []
        elif i == len(sorted_pts)-1:
            new_list.append([i, pt.Z])
            Grid.append(new_list)
            break
        new_list.append([i,pt.Z])
#    print len(Grid[2])
    return Grid


#find index of pointA (Start point) and pointB (Goal point) in the new ordered list
def Start_End_Points(sorted_pts):
    Start_point = []
    Goal_point = []
    for i, pt in enumerate(sorted_pts):
        if pt == PointA:
            Start_point.append(i)
        if pt == PointB:
            Goal_point.append(i)
    return Start_point[0], Goal_point[0]


#The Tree will be the playground of the Astar
#Tree is a dict that has every node as a key, and its lists of [neighbor + cost] as a value
#in the for loop a node = [pt_index, pt.Z]

def Playground(Grid):
    global max_Angle
    Tree = {}
    for i, list in enumerate(Grid):
        for j, node in enumerate(list):
            if i > 0 and abs(abs(node[1]) - abs(Grid[i-1][j][1])) / math.sqrt(12**2 + (abs(node[1]) - abs(Grid[i-1][j][1]))**2) < math.sin(max_Angle):
                Tree.setdefault(node[0], []).append([Grid[i-1][j][0], math.sqrt(math.pow(abs(abs(Grid[i-1][j][1])-abs(Grid[i][j][1])),2) + math.pow(12,2))])
            if j > 0 and abs(abs(node[1]) - abs(Grid[i][j-1][1])) / math.sqrt(12**2 + (abs(node[1]) - abs(Grid[i][j-1][1]))**2) < math.sin(max_Angle):
                Tree.setdefault(node[0], []).append([Grid[i][j-1][0], math.sqrt(math.pow(abs(abs(Grid[i][j-1][1])-abs(Grid[i][j][1])),2) + math.pow(12,2))])
            if i < len(Grid) - 1 and abs(abs(node[1]) - abs(Grid[i+1][j][1])) / math.sqrt(12**2 + (abs(node[1]) - abs(Grid[i+1][j][1]))**2) < math.sin(max_Angle):
                Tree.setdefault(node[0], []).append([Grid[i+1][j][0], math.sqrt(math.pow(abs(abs(Grid[i+1][j][1])-abs(Grid[i][j][1])),2) + math.pow(12,2))])
            if j < len(list) - 1 and abs(abs(node[1]) - abs(Grid[i][j+1][1])) / math.sqrt(12**2 + (abs(node[1]) - abs(Grid[i][j+1][1]))**2) < math.sin(max_Angle):
                Tree.setdefault(node[0], []).append([Grid[i][j+1][0], math.sqrt(math.pow(abs(abs(Grid[i][j+1][1])-abs(Grid[i][j][1])),2) + math.pow(12,2))])
    return Tree


#A second version that allows you to add breps to exclude points

def Playground_with_pt_exclusion(Grid):
    global max_Angle, excluded_pts
    Tree = {}
    for i, list in enumerate(Grid):
        for j, node in enumerate(list):
            if i > 0 and abs(abs(node[1]) - abs(Grid[i-1][j][1])) / math.sqrt(12**2 + (abs(node[1]) - abs(Grid[i-1][j][1]))**2) < math.sin(max_Angle) and sorted_pts[node[0]] not in excluded_pts and sorted_pts[Grid[i-1][j][0]] not in excluded_pts:
                Tree.setdefault(node[0], []).append([Grid[i-1][j][0], math.sqrt(math.pow(abs(abs(Grid[i-1][j][1])-abs(Grid[i][j][1])),2) + math.pow(12,2))])
            if j > 0 and abs(abs(node[1]) - abs(Grid[i][j-1][1])) / math.sqrt(12**2 + (abs(node[1]) - abs(Grid[i][j-1][1]))**2) < math.sin(max_Angle) and sorted_pts[node[0]] not in excluded_pts and sorted_pts[Grid[i][j-1][0]] not in excluded_pts:
                Tree.setdefault(node[0], []).append([Grid[i][j-1][0], math.sqrt(math.pow(abs(abs(Grid[i][j-1][1])-abs(Grid[i][j][1])),2) + math.pow(12,2))])
            if i < len(Grid) - 1 and abs(abs(node[1]) - abs(Grid[i+1][j][1])) / math.sqrt(12**2 + (abs(node[1]) - abs(Grid[i+1][j][1]))**2) < math.sin(max_Angle) and sorted_pts[node[0]] not in excluded_pts and sorted_pts[Grid[i+1][j][0]] not in excluded_pts:
                Tree.setdefault(node[0], []).append([Grid[i+1][j][0], math.sqrt(math.pow(abs(abs(Grid[i+1][j][1])-abs(Grid[i][j][1])),2) + math.pow(12,2))])
            if j < len(list) - 1 and abs(abs(node[1]) - abs(Grid[i][j+1][1])) / math.sqrt(12**2 + (abs(node[1]) - abs(Grid[i][j+1][1]))**2) < math.sin(max_Angle) and sorted_pts[node[0]] not in excluded_pts and sorted_pts[Grid[i][j+1][0]] not in excluded_pts:
                Tree.setdefault(node[0], []).append([Grid[i][j+1][0], math.sqrt(math.pow(abs(abs(Grid[i][j+1][1])-abs(Grid[i][j][1])),2) + math.pow(12,2))])
    return Tree



#Defining Dijkstra’s logic :  searching for neighbor nodes iteratively until finding goal node. Then using weight to loop over the sequence of points from goal to start to find the shortest path.



def DijkstraAlgorithm():
    global Tree, Start_point, Goal_point
    cost = {Start_point: 0}
    closed = []
    came_from = {}
    opened = [[Start_point, cost[Start_point]]]
    #Dijkstra’s Search logic
    while True:
        #pick a node
        node = opened[0][0]
        closed.append(opened[0])
        del opened[0]
        #End the loop if we reach the goal node
        if closed[-1][0] == Goal_point:
            print "Goal point found !"
            break
        for item in Tree[node]:
            if item[0] in [closed_item[0] for closed_item in closed]:
                continue
            cost_node = cost[node] + item[1]
            temp = [item[0], cost_node]
            if temp[0] in [open[0] for open in opened]:
                if cost[node] + item[1] < cost[temp[0]]:
                    cost.update({item[0]: cost[node] + item[1]})
                    chosen_index = [open[0] for open in opened].index(temp[0])
                    del opened[chosen_index]
                    opened.append(temp)
                    came_from[temp[0]] = node
            elif temp[0] not in [open[0] for open in opened]:
                cost.update({item[0]: cost[node] + item[1]})
                opened.append(temp)
                came_from[temp[0]] = node
        #Stopping the loop before having an error
        if len(opened) == 0:
            print "Failed to find the Goal point..."
            break
    #Loop back to find the sequence 
    trace_node = Goal_point
    optimal_sequence = [Goal_point]
    while trace_node in came_from.Keys:
        trace_node = came_from[trace_node]
        optimal_sequence.append(trace_node)
    
    
    optimal_sequence.reverse()
    
    return  closed, optimal_sequence



#Running the Code
if len(excluded_pts) == 0:
    try:
        sorted_pts = sort_pts(mesh_pts)
        Grid = pts_branched(sorted_pts)
        Start_point, Goal_point = Start_End_Points(sorted_pts)
        Tree = Playground(Grid)
        closed, optimal_sequence = DijkstraAlgorithm()
        closed = list_to_tree(closed)
    except Exception:
        print("Sorry, missing or wrong Data")
        
elif len(excluded_pts) != 0:
    try:
        sorted_pts = sort_pts(mesh_pts)
        Grid = pts_branched(sorted_pts)
        Start_point, Goal_point = Start_End_Points(sorted_pts)
        Tree = Playground_with_pt_exclusion(Grid)
        closed, optimal_sequence = DijkstraAlgorithm()
        closed = list_to_tree(closed)
    except Exception:
        print("Sorry, missing or wrong Data")
# ---------- end python_4 ----------
max_angle_in_degrees_3 = Panel(deg_3)
item_4 = ListItem(List=python_4.sorted_pts, Index=python_4.optimal_sequence, Wrap=True)
panel_7 = Panel(python_4.out)
pline_4 = PolyLine(Vertices=item_4, Closed=False)
len_4 = Length(Curve=pline_4)
panel_8 = Panel(len_4)

# ----
deg_4 = Degrees(Radians=division_3)
max_angle_in_degrees_4 = Panel(deg_4)

# ---- group: A star Algorithm that can adapt to all meshes / Searched points Visualisation
item_5 = ListItem(List=python_2.closed, Index=0, Wrap=True)
item_6 = ListItem(List=python_2.sorted_pts, Index=item_5, Wrap=True)
dots = DotDisplay(Point=item_6, Colour=RGB(0, 0, 0), Size=Slider(4, range=0..10))

# ---- group: Dijkstra’s Algorithm that can adapt to all meshes / Searched points Visualisation
item_7 = ListItem(List=python.closed, Index=0, Wrap=True)
item_8 = ListItem(List=python.sorted_pts, Index=item_7, Wrap=True)
dots_2 = DotDisplay(Point=item_8, Colour=RGB(0, 0, 0), Size=Slider(4, range=0..10))

# ---- group: Dijkstra’s Algorithm made for rectangular orthogonal meshes / Searched points Visualisation
item_9 = ListItem(List=python_4.closed, Index=0, Wrap=True)
item_10 = ListItem(List=python_4.sorted_pts, Index=item_9, Wrap=True)
dots_3 = DotDisplay(Point=item_10, Colour=RGB(0, 0, 0), Size=Slider(4, range=0..10))

# ---- group: A star Algorithm made for rectangular orthogonal meshes / Searched points Visualisation
item_11 = ListItem(List=python_3.closed, Index=0, Wrap=True)
item_12 = ListItem(List=python_3.sorted_pts, Index=item_11, Wrap=True)
# Light versions of Astar and Dijkstra that
# works only with orthographic
# rectangular meshes
dots_4 = DotDisplay(Point=item_12, Colour=RGB(0, 0, 0), Size=Slider(4, range=0..10))

# ---- group: Prim–Jarník Algorithm
crv_3 = Curve(<curve referenced from the Rhino model>)
# Simple Example Prim Jarnik Algorithm
pop2d = Populate2D(Region=crv_3, Count=Slider(50, range=0..100), Seed=Slider(49, range=0..100))
number_slider = Slider(0, range=0..10)
cp_5 = ClosestPoint(Point=pop2d, Cloud=demesh.Vertices)  # -> ClosestPoint, CPIndex, Distance
number_slider_2 = Slider(200, range=0..1000)
con = DelaunayEdges(Points=cp_5.ClosestPoint, Plane=PlaneXY(0, 0, 0))  # -> flatten(Connectivity), flatten(Edges)

# ----
python_5 = GhPythonScript(edges=con.Edges, seed=number_slider_2, num_additional_edges=number_slider)  # -> out, MSTgrid; inputs edges: list of Line, num_additional_edges: Int32
# ---------- python_5: Python ----------
import Rhino.Geometry as rg
import random

#Extract end points from every edge and
#Create a dict : for every point and its neighbor nodes; node = [neighbor_pt + cost] 
#which will be the playground for our prim's Algorithm


def Playground(edges):
    
    Edges_pts = {}
    set_points = set()
    
    for edge in edges:
        ptS = edge.PointAt(0)
        ptE = edge.PointAt(1)
        Edges_pts.setdefault(ptS, []).append([ptE,edge.Length, ptS])
        Edges_pts.setdefault(ptE,[]).append([ptS,edge.Length, ptE])
        set_points.add(ptS)
        set_points.add(ptE)
        
    return Edges_pts, set_points

#Function to find the smallest cost among a list of nodes

def find(candidates):
    cost_candidates = [node[1] for node in candidates]
    chosen_index = cost_candidates.index(min(cost_candidates))
    node = candidates[chosen_index]
    return node


#Prim's Algorithm logic

def Prim_Algorithm(Edges_pts, N):

    MST = []
    Visited = []
    candidates = []
    Visited.append(random.choice(list(Edges_pts)))
    
    
    while len(MST) < N:
        for selected in Visited:
            for node in Edges_pts[selected]:
                if node[0] not in Visited:
                    candidates.append(node)
        chosen_node = find(candidates)
        MST.append([chosen_node[0],chosen_node[2]])
        Visited.append(chosen_node[0])
        candidates = []
    return MST


#Extract the Minimum Spanning Grid

def MSTgrid_Creator(MST):
    MSTgrid = []
    
    for list in MST:
        line = rg.Line(list[0],list[1])
        MSTgrid.append(line)
    return MSTgrid


#Randomly add segments to increase the porosity of the network

def add_porosity(edges, MSTgrid, num_additional_edges):
    global seed
    random.seed(seed)
    
    out_lines = []
    for line in edges:
        if line not in MSTgrid:
            out_lines.append(line)
    
    add_lines = random.sample(out_lines, num_additional_edges)
    
    MSTgrid.extend(add_lines)
    return MSTgrid


#Runnning the code

try:
    Edges_pts, set_points = Playground(edges)
    #NV is the number of unique vertices  and N is the number of edges our mst should have
    NV = len(set_points)
    N = NV - 1
    MST = Prim_Algorithm(Edges_pts, N)
    MSTgrid = MSTgrid_Creator(MST)
    MSTgrid = add_porosity(edges, MSTgrid, num_additional_edges)
except Exception:
    print("Sorry, missing or wrong Data")
# ---------- end python_5 ----------

# ---- group: Loop over MST grid edges, to recreate path through topography using the Astar Algorithm
ins = InsertItems(Wrap=True)

# ---- group: Prim–Jarník Algorithm (continued)
crv_4 = Curve(python_5.MSTgrid)
end_2 = EndPoints(Curve=crv_4)  # -> Start, End

# ---- group: Loop over MST grid edges, to recreate path through topography using the Astar Algorithm (continued)
lng = ListLength(List=crv_4)
expression = Expression(x=lng, Expression="x-1")
loop_start = LoopStart(Repeat=expression, Data=ins)  # -> port, Counter, Data; disabled
# Loop using Anemone plugin components
panel_9 = Panel(loop_start.Counter)
merge_2 = Merge(Data1=loop_start.Data, Data2=pline_3)  # -> flatten(Result)
loop_paused = LoopPaused(port=loop_start.port, Exit=False, Data=merge_2, TimeOutVal=0, pausedState=True, state="Constant output")
null = NullItem(Item=loop_paused)  # -> NullFlags, InvalidFlags, Description
cull_5 = CullPattern(List=loop_paused, CullPattern=invert(null.NullFlags))
smoothpline = SmoothPolyline(Polyline=cull_5, Strength=1, Times=Slider(14, range=0..100))

# ---- group: Prim–Jarník Algorithm (continued)
# Combining
# Prim's and Astar
#      Algorithms
item_13 = ListItem(List=end_2.Start, Index=loop_start.Counter, Wrap=True)
item_14 = ListItem(List=end_2.End, Index=loop_start.Counter, Wrap=True)
