# Grasshopper definition Example_Iterative_network_generation_with_Astar.ghx (Grasshopper 1.0.7)
# plug-ins: Anemone

# ---- group: arborescence pour animation
crv = Curve([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])
mesh = Mesh(<mesh referenced from the Rhino model>)
loop_start = LoopStart(Repeat=Slider(20, range=0..500), Data=crv)  # -> port, Counter, Data; disabled
panel = Panel(loop_start.Counter)
multiplication = Multiplication(A=loop_start.Counter, B=Slider(5, range=0..10))
demesh = DeconstructMesh(Mesh=mesh)  # -> Vertices, Faces, Colours, Normals
popgeo = PopulateGeometry(Geometry=mesh, Count=Slider(1, range=0..10), Seed=multiplication)
cp = ClosestPoint(Point=popgeo, Cloud=demesh.Vertices)  # -> ClosestPoint, CPIndex, Distance
pull = PullPoint(Point=cp.ClosestPoint, Geometry=loop_start.Data, ClosestOnly=True)  # -> ClosestPoint, Distance
cp_2 = ClosestPoint(Point=pull.ClosestPoint, Cloud=demesh.Vertices)  # -> ClosestPoint, CPIndex, Distance
pi = Pi(Factor=1)
division = Division(A=pi, B=Slider(6, range=1..10))

# ---- group: Astar Algorithm
python = GhPythonScript(mesh_pts=demesh.Vertices, PointA=cp_2.ClosestPoint, PointB=cp.ClosestPoint, max_Angle=division)  # -> out, sorted_pts, optimal_sequence, closed; inputs mesh_pts: list of Point3d, PointA: Point3d, PointB: Point3d, excluded_pts: list of Point3d
# ---------- python: Python ----------
import Rhino.Geometry as rg
import math
from ghpythonlib.treehelpers import list_to_tree



#We sort the points of the topography in the X and the Y axis
def sort_pts(mesh_pts):
    pt_sort = []
    for i, pt in enumerate(mesh_pts):
        pt_sort.append(pt.X*10000 + pt.Y*10)
    sortedp = sorted(zip(mesh_pts, pt_sort))
    sorted_pts = []
    #unpack tuples and retrieve only the points
    for pt, val in sortedp:
        sorted_pts.append(pt)
        
    return sorted_pts


#We split the plain list into list of lists to make neighbor search easier
def pts_branched(sorted_pts):
    Grid = []
    new_list = []
    for i, pt in enumerate(sorted_pts):
        if (i != 0 and pt.X != sorted_pts[i-1].X):
            Grid.append(new_list)
            new_list = []
        elif i == len(sorted_pts)-1:
            new_list.append([i, pt.Z])
            Grid.append(new_list)
            break
        new_list.append([i,pt.Z])
    return Grid


#find index of pointA (Start point) and pointB (Goal point) in the new ordered list
def Start_End_Points(sorted_pts):
    Start_point = []
    Goal_point = []
    for i, pt in enumerate(sorted_pts):
        if pt == PointA:
            Start_point.append(i)
        if pt == PointB:
            Goal_point.append(i)
    return Start_point[0], Goal_point[0]


#The Tree will be the playground of the Astar
#Tree is a dict that has every node as a key, and its lists of [neighbor + cost] as a value
#in the for loop a node = [pt_index, pt.Z]

def Playground(Grid):
    global max_Angle
    Tree = {}
    for i, list in enumerate(Grid):
        for j, node in enumerate(list):
            if i > 0 and abs(abs(node[1]) - abs(Grid[i-1][j][1])) / math.sqrt(12**2 + (abs(node[1]) - abs(Grid[i-1][j][1]))**2) < math.sin(max_Angle):
                Tree.setdefault(node[0], []).append([Grid[i-1][j][0], math.sqrt(math.pow(abs(abs(Grid[i-1][j][1])-abs(Grid[i][j][1])),2) + math.pow(12,2))])
            if j > 0 and abs(abs(node[1]) - abs(Grid[i][j-1][1])) / math.sqrt(12**2 + (abs(node[1]) - abs(Grid[i][j-1][1]))**2) < math.sin(max_Angle):
                Tree.setdefault(node[0], []).append([Grid[i][j-1][0], math.sqrt(math.pow(abs(abs(Grid[i][j-1][1])-abs(Grid[i][j][1])),2) + math.pow(12,2))])
            if i < len(Grid) - 1 and abs(abs(node[1]) - abs(Grid[i+1][j][1])) / math.sqrt(12**2 + (abs(node[1]) - abs(Grid[i+1][j][1]))**2) < math.sin(max_Angle):
                Tree.setdefault(node[0], []).append([Grid[i+1][j][0], math.sqrt(math.pow(abs(abs(Grid[i+1][j][1])-abs(Grid[i][j][1])),2) + math.pow(12,2))])
            if j < len(list) - 1 and abs(abs(node[1]) - abs(Grid[i][j+1][1])) / math.sqrt(12**2 + (abs(node[1]) - abs(Grid[i][j+1][1]))**2) < math.sin(max_Angle):
                Tree.setdefault(node[0], []).append([Grid[i][j+1][0], math.sqrt(math.pow(abs(abs(Grid[i][j+1][1])-abs(Grid[i][j][1])),2) + math.pow(12,2))])
    return Tree


#A second version that allows you to add breps to exclude points

def Playground_with_pt_exclusion(Grid):
    global max_Angle, excluded_pts
    Tree = {}
    for i, list in enumerate(Grid):
        for j, node in enumerate(list):
            if i > 0 and abs(abs(node[1]) - abs(Grid[i-1][j][1])) / math.sqrt(12**2 + (abs(node[1]) - abs(Grid[i-1][j][1]))**2) < math.sin(max_Angle) and sorted_pts[node[0]] not in excluded_pts and sorted_pts[Grid[i-1][j][0]] not in excluded_pts:
                Tree.setdefault(node[0], []).append([Grid[i-1][j][0], math.sqrt(math.pow(abs(abs(Grid[i-1][j][1])-abs(Grid[i][j][1])),2) + math.pow(12,2))])
            if j > 0 and abs(abs(node[1]) - abs(Grid[i][j-1][1])) / math.sqrt(12**2 + (abs(node[1]) - abs(Grid[i][j-1][1]))**2) < math.sin(max_Angle) and sorted_pts[node[0]] not in excluded_pts and sorted_pts[Grid[i][j-1][0]] not in excluded_pts:
                Tree.setdefault(node[0], []).append([Grid[i][j-1][0], math.sqrt(math.pow(abs(abs(Grid[i][j-1][1])-abs(Grid[i][j][1])),2) + math.pow(12,2))])
            if i < len(Grid) - 1 and abs(abs(node[1]) - abs(Grid[i+1][j][1])) / math.sqrt(12**2 + (abs(node[1]) - abs(Grid[i+1][j][1]))**2) < math.sin(max_Angle) and sorted_pts[node[0]] not in excluded_pts and sorted_pts[Grid[i+1][j][0]] not in excluded_pts:
                Tree.setdefault(node[0], []).append([Grid[i+1][j][0], math.sqrt(math.pow(abs(abs(Grid[i+1][j][1])-abs(Grid[i][j][1])),2) + math.pow(12,2))])
            if j < len(list) - 1 and abs(abs(node[1]) - abs(Grid[i][j+1][1])) / math.sqrt(12**2 + (abs(node[1]) - abs(Grid[i][j+1][1]))**2) < math.sin(max_Angle) and sorted_pts[node[0]] not in excluded_pts and sorted_pts[Grid[i][j+1][0]] not in excluded_pts:
                Tree.setdefault(node[0], []).append([Grid[i][j+1][0], math.sqrt(math.pow(abs(abs(Grid[i][j+1][1])-abs(Grid[i][j][1])),2) + math.pow(12,2))])
    return Tree


#Heuristic is a dict that contains everypoint and its heuristic value which is the distance to the goal point (PointB).

def heuristic(sorted_pts):
    Heuristic = {}
    for i, pt in enumerate(sorted_pts):
        Heuristic[i] = pt.DistanceTo(PointB)
    return Heuristic

#Defining Astar logic, searching nodes with the best cumulated cost (heuristic + gcost) until finding goal node. Then using weight to loop over the sequence of points from goal to start.



def AstarAlgorithm():
    global Tree, Heuristic, Start_point, Goal_point
    cost = {Start_point: 0}
    closed = []
    came_from = {}
    opened = [[Start_point, Heuristic[Start_point]]]
    #A Star Search logic
    while True:
        fn = [i[1] for i in opened]
        chosen_index = fn.index(min(fn))
        node = opened[chosen_index][0]
        closed.append(opened[chosen_index])
        del opened[chosen_index]
        #End the loop if we reach the goal node
        if closed[-1][0] == Goal_point:
            print "Goal point found !"
            break
        for item in Tree[node]:
            if item[0] in [closed_item[0] for closed_item in closed]:
                continue
            fn_node = cost[node] + (Heuristic[item[0]]) + item[1]
            temp = [item[0], fn_node]
            if temp[0] in [open[0] for open in opened]:
                if cost[node] + item[1] < cost[temp[0]]:
                    cost.update({item[0]: cost[node] + item[1]})
                    chosen_index = [open[0] for open in opened].index(temp[0])
                    del opened[chosen_index]
                    opened.append(temp)
                    came_from[temp[0]] = node
            elif temp[0] not in [open[0] for open in opened]:
                cost.update({item[0]: cost[node] + item[1]})
                opened.append(temp)
                came_from[temp[0]] = node
        #Stopping the loop before having an error
        if len(opened) == 0:
            print "Failed to find the Goal point..."
            break
    #Loop back to find the sequence 
    trace_node = Goal_point
    optimal_sequence = [Goal_point]
    while trace_node in came_from.Keys:
        trace_node = came_from[trace_node]
        optimal_sequence.append(trace_node)
    
    
    optimal_sequence.reverse()
    
    return  closed, optimal_sequence



#Running the Code
if len(excluded_pts) == 0:
    try:
        sorted_pts = sort_pts(mesh_pts)
        Grid = pts_branched(sorted_pts)
        Start_point, Goal_point = Start_End_Points(sorted_pts)
        Tree = Playground(Grid)
        Heuristic = heuristic(sorted_pts)
        closed, optimal_sequence = AstarAlgorithm()
        closed = list_to_tree(closed)
    except Exception:
        print("Sorry, missing or wrong Data")
        
elif len(excluded_pts) != 0:
    try:
        sorted_pts = sort_pts(mesh_pts)
        Grid = pts_branched(sorted_pts)
        Start_point, Goal_point = Start_End_Points(sorted_pts)
        Tree = Playground_with_pt_exclusion(Grid)
        Heuristic = heuristic(sorted_pts)
        closed, optimal_sequence = AstarAlgorithm()
        closed = list_to_tree(closed)
    except Exception:
        print("Sorry, missing or wrong Data")
# ---------- end python ----------

# ---- group: arborescence pour animation (continued)
item = ListItem(List=python.sorted_pts, Index=python.optimal_sequence, Wrap=True)
panel_2 = Panel(python.out)
pline = PolyLine(Vertices=item, Closed=False)
merge = Merge(Data1=flatten(pline), Data2=flatten(loop_start.Data))  # -> flatten(Result)
loop_end = LoopEnd(port=loop_start.port, Exit=False, Data=merge, TimeOutVal=0, pausedState=False, state="Constant output")  # disabled
smoothpline = SmoothPolyline(Polyline=merge, Strength=1, Times=Slider(3, range=0..10))
